# Grasshopper definition box.gh (Grasshopper 0.9.76)
# plug-ins: Python Interpreter

# ---- group: get path to input file
python = PythonScript()  # -> path
# ---------- python: Python ----------
path = ghenv.Component.OnPingDocument().FilePath
path = path.split("\\")
path = "\\".join(path[:-1] + ["inputs.txt"])
# ---------- end python ----------

# ----
file = ReadFile(File=python, PerLineParse=True)
bang = ExplodeTree(Data=simplify(graft(file)))  # -> Branch0, Branch1, Branch2
pt = ConstructPoint(XCoordinate=0, YCoordinate=0, ZCoordinate=0)
pt_2 = ConstructPoint(XCoordinate=bang.Branch0, YCoordinate=bang.Branch1, ZCoordinate=bang.Branch2)
box = Box2Pt(PointA=pt, PointB=pt_2, Plane=PlaneXY(0, 0, 0))
geo = Geometry(box)
area = Area(Geometry=geo)  # -> Area, Centroid
volume = Volume(Geometry=geo)  # -> Volume, Centroid
merge = Merge(Data1=area.Area, Data2=volume.Volume)

# ---- group: screenshot
python_2 = PythonScript()  # -> path
# ---------- python_2: Python ----------
path = ghenv.Component.OnPingDocument().FilePath
path = path.split("\\")
path = "\\".join(path[:-1] + ["gh.ping"])
# ---------- end python_2 ----------
file_2 = ReadFile(File=python_2, PerLineParse=True)
python_3 = PythonScript(id=file_2)  # -> out
# ---------- python_3: Python ----------
import pickle
import rhinoscriptsyntax as rs

localFolder = "\\".join(ghenv.Component.OnPingDocument().FilePath.split("\\")[:-1]) + "\\"

with open(localFolder + "meta.file", 'rb') as f:
    meta = pickle.load(f)

jobID = meta['jobID']
#    designID = meta['designID']

imageFolder = localFolder + str(jobID) + "\\images\\"
imageName = imageFolder + str(id) + ".png"
rs.Command("_-ViewCaptureToFile \n\"" + imageName + "\"\n _Enter")

outputFile = localFolder + "python.ping"
with open(outputFile, 'w') as f:
    f.write('ack')

print "complete"
# ---------- end python_3 ----------

# ---- group: write to output file
python_4 = PythonScript(data=merge)  # -> out; inputs data: list
# ---------- python_4: Python ----------
import pickle
import rhinoscriptsyntax as rs

localFolder = "\\".join(ghenv.Component.OnPingDocument().FilePath.split("\\")[:-1]) + "\\"

outputFile = localFolder + "outputs.txt"
with open(outputFile, 'w') as f:
    f.write('\n'.join([str(x) for x in data]))

print "complete"
# ---------- end python_4 ----------
