# Grasshopper definition bridge_constraint.gh (Grasshopper 0.9.76)
# plug-ins: Karamba, Python Interpreter, HDTReference

# ---- group: Discover Inputs / get inputs from job results
python = PythonScript(jobName="_bridge_170111_150657", id="9704")  # -> inputs
# ---------- python: Python ----------
path = ghenv.Component.OnPingDocument().FilePath
path = path.split("\\")
path = "\\".join(path[:-1] + [jobName, "results.tsv"])

with open(path, 'r') as f:
    data = f.readlines()

headers = data.pop(0).split('\t')

designs = {}
for d in data:
    line = d.split('\t')
    designs[ int(line[headers.index('id')]) ] = [x for i,x in enumerate(line) if "[in" in headers[i]]

inputs = designs[int(id)]
# ---------- end python ----------

# ---- group: Discover Inputs / get inputs from file
python_2 = PythonScript()  # -> path
# ---------- python_2: Python ----------
path = ghenv.Component.OnPingDocument().FilePath
path = path.split("\\")
path = "\\".join(path[:-1] + ["inputs.txt"])
# ---------- end python_2 ----------
file = ReadFile(File=python_2, PerLineParse=True)

# ----
bang = ExplodeTree(Data=simplify(graft(file)))  # -> Branch0, Branch1, Branch2, Branch3, Branch4, Branch5, Branch6, Branch7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
crv = Curve(<curve referenced from the Rhino model>)
number_slider = Slider(3.74, range=0..10)
number_slider_2 = Slider(5.2, range=0..10)
merge = Merge(Data1=bang.Branch0, Data2=bang.Branch1, Data3=bang.Branch2, Data4=bang.Branch3, Data5=bang.Branch4, Data6=bang.Branch5)  # -> flatten(Result)
merge_2 = Merge(Data1=bang.Branch6, Data2=bang.Branch7, Data3=bang.Branch8, Data4=bang.Branch9, Data5=bang.Branch10)  # -> flatten(Result)
cp = ControlPoints(Curve=crv)  # -> Points, Weights, Knots
Y = UnitY(Factor=bang.Branch12)
Y_2 = UnitY(Factor=bang.Branch11)
bang_2 = ExplodeTree(Data=simplify(graft(cp.Points)))  # -> Branch0, Branch1, Branch2, Branch3
item = ListItem(List=bang_2.Branch1, Index=Slider(1, range=0..1), Wrap=True)
item_2 = ListItem(List=bang_2.Branch2, Index=Slider(2, range=0..10), Wrap=True)
rev = Reverse(Vector=Y)
move = Move(Geometry=item, Motion=Y_2)  # -> Geometry, Transform
move_2 = Move(Geometry=item_2, Motion=rev)  # -> Geometry, Transform
merge_3 = Merge(Data1=bang_2.Branch0, Data2=move.Geometry, Data3=move_2.Geometry, Data4=bang_2.Branch3)  # -> flatten(Result)
merge_4 = Merge(Data1=bang_2.Branch0, Data2=bang_2.Branch3)  # -> flatten(Result)
genes = GenePool(Decimals=2, Maximum=5, Minimum=0, Value=[0, 1.79, 2.49, 2.48, 1.79, 0])
genes_2 = GenePool(Decimals=2, Maximum=3.99, Minimum=0, Value=[0.7312476995, 1.443250909, 2.509755155, 2.475490619, 3.635233237])
nurbs = NurbsCurve(Vertices=merge_3, Degree=3, Periodic=False)  # -> Curve, Length, Domain
divide = DivideCurve(Curve=nurbs.Curve, Count=Slider(5, range=0..10), Kinks=False)  # -> Points, Tangents, Parameters
Z = UnitZ(Factor=merge)
round = Round(Number=merge_2)  # -> Nearest, Floor, Ceiling
move_3 = Move(Geometry=divide.Points, Motion=Z)  # -> Geometry, Transform
python_3 = PythonScript(pts1=divide.Points, pts2=move_3.Geometry, types=round.Floor)  # -> out, lines; inputs pts1: list, pts2: list, types: list
# ---------- python_3: Python ----------
import rhinoscriptsyntax as rs

lines = []

for i, type in enumerate(types):
    if type == 1:
        lines.append(rs.AddLine(pts1[i], pts2[i+1]))
    if type == 2:
        lines.append(rs.AddLine(pts2[i], pts1[i+1]))
    if type == 3:
        lines.append(rs.AddLine(pts1[i], pts2[i+1]))
        lines.append(rs.AddLine(pts2[i], pts1[i+1]))
# ---------- end python_3 ----------
pline = PolyLine(Vertices=divide.Points, Closed=False)
pline_2 = PolyLine(Vertices=move_3.Geometry, Closed=False)
ln = Line(StartPoint=divide.Points, EndPoint=move_3.Geometry)
crv_2 = Curve([<curve referenced from the Rhino model> x2])
explode = Explode(Curve=pline, Recursive=True)  # -> Segments, Vertices
explode_2 = Explode(Curve=pline_2, Recursive=True)  # -> Segments, Vertices
incurves = PointInCurves(Point=divide.Points, Curves=crv_2)  # -> Relationship, Index, Point
merge_5 = Merge(Data1=ln, Data2=explode_2.Segments, Data3=python_3.lines)  # -> flatten(Result)
Z_2 = UnitZ(Factor=Slider(1, range=0..1))
trim = TrimWithRegion(Curve=pline, Region=crv_2)  # -> flatten(Inside), flatten(Outside)
rev_2 = Reverse(Vector=Z_2)
ma = MassAddition(Input=incurves.Relationship)  # -> Result, PartialResults
geo = Geometry(trim.Inside)
linetobeam = LineToBeamKaramba(Line=merge_5, New=True, Remove=True, LimitDistance_m=0.005, BeamIdentifier="structure")  # -> Points, Element, Info
linetobeam_2 = LineToBeamKaramba(Line=explode.Segments, New=True, Remove=True, LimitDistance_m=0.005, BeamIdentifier="road")  # -> Points, Element, Info
loads = LoadsKaramba(Vector=rev_2, BeamIdentifierS="road", LCase=0, mode="Uniform Line", menu=[buttons(off, on, off)])
supp = SupportKaramba(PosInd=merge_4, menu=[buttons(on, on, on, on, on, off)])
previewlw = CustomPreviewLineweights(
    Geometry=geo,
    Shader={ambient=RGB(0, 0, 0), diffuse=RGB(255, 105, 180), emission=RGB(76, 32, 54), shine=0.5, specular=RGB(255, 255, 255), transparency=0},
    Thickness=Slider(5, range=0..10))
len = Length(Curve=trim.Outside)
len_2 = Length(Curve=trim.Inside)
merge_6 = Merge(Data1=linetobeam_2.Element, Data2=linetobeam.Element)  # -> flatten(Result)
ma_2 = MassAddition(Input=len_2)  # -> Result, PartialResults
ma_3 = MassAddition(Input=len)  # -> Result, PartialResults
eval = Evaluate(F="x / (x+y)", x=ma_2.Result, y=ma_3.Result)
assemble = AssembleModelKaramba(Elem=merge_6, Support=supp, Load=loads, LimitDistance_m=0.005)  # -> Model, Info, Mass_kg, CenterOfGravity
percent_in_obstruction_min = Panel(eval)
analyzethi = AnalyzeThIKaramba(Model=assemble.Model)  # -> CalculatedModel, MaximumDisplacement_m, ResultingForceOfGravity_kN, ElasticEnergy_kNm
displacement_min = Panel(analyzethi.MaximumDisplacement_m)
material_min = Panel(assemble.Mass_kg)
modelview = ModelViewKaramba(Model=analyzethi.CalculatedModel, LoadCaseFactorsForLinearSuperposition=1, IndexIncrementOfVisibleLoadcase=0)  # -> Model, DeformedMesh, DeformedAxes, DeformedModel
beamview = BeamViewKaramba(Model=modelview.Model)  # -> Model, MeshesOfRenderedBeams, DeformedBeamAxes, LegendColors, LegendTags

# ---- group: Discover Outputs / write to output file
merge_7 = Merge(Data1=flatten(displacement_min), Data2=flatten(material_min), Data3=flatten(percent_in_obstruction_min))  # -> flatten(Result)
python_4 = PythonScript(data=merge_7)  # -> out; inputs data: list
# ---------- python_4: Python ----------
import pickle
import rhinoscriptsyntax as rs

localFolder = "\\".join(ghenv.Component.OnPingDocument().FilePath.split("\\")[:-1]) + "\\"

outputFile = localFolder + "outputs.txt"
with open(outputFile, 'w') as f:
    f.write('\n'.join([str(x) for x in data]))

print "complete"
# ---------- end python_4 ----------

# ---- group: Discover Outputs / take screenshot
python_5 = PythonScript()  # -> path
# ---------- python_5: Python ----------
path = ghenv.Component.OnPingDocument().FilePath
path = path.split("\\")
path = "\\".join(path[:-1] + ["gh.ping"])
# ---------- end python_5 ----------
file_2 = ReadFile(File=python_5, PerLineParse=True)
python_6 = PythonScript(id=file_2)  # -> out
# ---------- python_6: Python ----------
import pickle
import rhinoscriptsyntax as rs

localFolder = "\\".join(ghenv.Component.OnPingDocument().FilePath.split("\\")[:-1]) + "\\"

with open(localFolder + "meta.file", 'rb') as f:
    meta = pickle.load(f)

jobID = meta['jobID']
#    designID = meta['designID']

imageFolder = localFolder + str(jobID) + "\\images\\"
imageName = imageFolder + str(id) + ".png"
rs.Command("_-ViewCaptureToFile \n\"" + imageName + "\"\n _Enter")

outputFile = localFolder + "python.ping"
with open(outputFile, 'w') as f:
    f.write('ack')

print "complete"
# ---------- end python_6 ----------

# ----
b_res_force = BeamResultantForcesKaramba(AnalyzedModel=beamview.Model, LoadCase=-1, MaximumProbingDistance_m=-1, NumberOfProbingPointsPerElement=3)  # -> AnalyzedModel, NormalForce_kN, ResultantBendingMoment_kNm, ResultantShearForce_kN
abs = Absolute(Value=b_res_force.NormalForce_kN)
bnd = Bounds(Numbers=abs)
dedomain = DeconstructDomain(Domain=bnd)  # -> Start, End
max_stress_min = Panel(dedomain.End)
