# Grasshopper definition function.gh (Grasshopper 0.9.76)
# plug-ins: Python Interpreter

# ---- group: get path to input file
python = PythonScript()  # -> path
# ---------- python: Python ----------
path = ghenv.Component.OnPingDocument().FilePath
path = path.split("\\")
path = "\\".join(path[:-1] + ["inputs.txt"])
# ---------- end python ----------

# ----
file = ReadFile(File=python, PerLineParse=True)
bang = ExplodeTree(Data=simplify(graft(file)))  # -> Branch0, Branch1, Branch2
eval = Evaluate(F="4*x^2 + 4*y^2", x=bang.Branch0, y=bang.Branch1)
eval_2 = Evaluate(F="(x-5)^2 + (y-5)^2", x=bang.Branch0, y=bang.Branch1)
merge = Merge(Data1=eval, Data2=eval_2)

# ---- group: write to output file
python_2 = PythonScript(data=merge, screenshot=Toggle(False))  # -> out; inputs data: list
# ---------- python_2: Python ----------
import pickle
import rhinoscriptsyntax as rs

localFolder = "\\".join(ghenv.Component.OnPingDocument().FilePath.split("\\")[:-1]) + "\\"

if screenshot:
    with open(localFolder + "meta.file", 'rb') as f:
        meta = pickle.load(f)
    
    jobID = meta['jobID']
    designID = meta['designID']
    
    imageFolder = localFolder + str(jobID) + "\\images\\"
    imageName = imageFolder + str(designID) + ".png"
    rs.Command("_-ViewCaptureToFile \n\"" + imageName + "\"\n _Enter")
outputFile = localFolder + "outputs.txt"

with open(outputFile, 'w') as f:
    f.write('\n'.join([str(x) for x in data]))

print "complete"
# ---------- end python_2 ----------
