# Grasshopper definition function_with constraints.gh (Grasshopper 0.9.76)
# plug-ins: Python Interpreter

# ---- group: get path to input file
python = PythonScript()  # -> path
# ---------- python: Python ----------
path = ghenv.Component.OnPingDocument().FilePath
path = path.split("\\")
path = "\\".join(path[:-1] + ["inputs.txt"])
# ---------- end python ----------

# ----
file = ReadFile(File=python, PerLineParse=True)
bang = ExplodeTree(Data=simplify(graft(file)))  # -> Branch0, Branch1

# ---- group: optimization functions
# Binh and Korn function
panel = Panel("4*x^2 + 4*y^2")
eval = Evaluate(F=panel, x=bang.Branch0, y=bang.Branch1)
eval_2 = Evaluate(F="(x-5)^2 + (y-5)^2", x=bang.Branch0, y=bang.Branch1)

# ---- group: constraint functions
eval_3 = Evaluate(F="(x-5)^2 + y^2", x=bang.Branch0, y=bang.Branch1)
eval_4 = Evaluate(F="(x-8)^2 + (y+3)^2", x=bang.Branch0, y=bang.Branch1)

# ----
merge = Merge(Data1=eval, Data2=eval_2, Data3=eval_3, Data4=eval_4)

# ---- group: write to output file
python_2 = PythonScript(data=merge)  # -> out; inputs data: list
# ---------- python_2: Python ----------
import pickle
import rhinoscriptsyntax as rs

localFolder = "\\".join(ghenv.Component.OnPingDocument().FilePath.split("\\")[:-1]) + "\\"

outputFile = localFolder + "outputs.txt"
with open(outputFile, 'w') as f:
    f.write('\n'.join([str(x) for x in data]))

print "complete"
# ---------- end python_2 ----------
