# Grasshopper definition hill.gh (Grasshopper 0.9.76)
# plug-ins: Python Interpreter

# ---- group: get path to input file
python = PythonScript()  # -> path
# ---------- python: Python ----------
path = ghenv.Component.OnPingDocument().FilePath
path = path.split("\\")
path = "\\".join(path[:-1] + ["inputs.txt"])
# ---------- end python ----------

# ----
file = ReadFile(File=python, PerLineParse=True)
bang = ExplodeTree(Data=simplify(graft(file)))  # -> Branch0, Branch1
pt = ConstructPoint(XCoordinate=bang.Branch0, YCoordinate=bang.Branch1, ZCoordinate=0)
Z = UnitZ(Factor=1)
geo = Geometry(<brep referenced from the Rhino model>)
project = ProjectPoint(Point=pt, Direction=Z, Geometry=geo)  # -> Point, Index
pdecon = Deconstruct(Point=project.Point)  # -> XComponent, YComponent, ZComponent
merge = Merge(Data1=pdecon.ZComponent)

# ---- group: write to output file
python_2 = PythonScript(data=merge, active=Toggle(True))  # -> out; inputs data: list
# ---------- python_2: Python ----------
import pickle
import rhinoscriptsyntax as rs

if active:

    localFolder = "\\".join(ghenv.Component.OnPingDocument().FilePath.split("\\")[:-1]) + "\\"
    outputFile = localFolder + "outputs.txt"
    
    with open(localFolder + "meta.file", 'rb') as f:
        meta = pickle.load(f)
    
    jobID = meta['jobID']
    designID = meta['designID']
    
    imageFolder = localFolder + str(jobID) + "\\images\\"
    imageName = imageFolder + str(designID) + ".png"
    rs.Command("_-ViewCaptureToFile \n\"" + imageName + "\"\n _Enter")
    
    with open(outputFile, 'w') as f:
        f.write('\n'.join([str(x) for x in data]))
    
    print "complete"
# ---------- end python_2 ----------
