# Grasshopper definition salesman.gh (Grasshopper 0.9.76)
# plug-ins: Python Interpreter, HDTReference

# ---- group: get path to input file
python = PythonScript()  # -> path
# ---------- python: Python ----------
path = ghenv.Component.OnPingDocument().FilePath
path = path.split("\\")
path = "\\".join(path[:-1] + ["inputs.txt"])
# ---------- end python ----------

# ----
file = ReadFile(File=python, PerLineParse=True)
bang = ExplodeTree(Data=simplify(graft(file)))

# ---- group: unpack series
python_2 = PythonScript(x=bang)  # -> a
# ---------- python_2: Python ----------
import json
a = json.loads(x)
# ---------- end python_2 ----------

# ----
pipeline = GeometryPipeline(
    GroupByLayer=False,
    GroupByType=False,
    IncludeHidden=True,
    IncludeLocked=True,
    LayerFilter="start",
    NameFilter="*",
    TypeFilter=1)
pipeline_2 = GeometryPipeline(
    GroupByLayer=False,
    GroupByType=False,
    IncludeHidden=True,
    IncludeLocked=True,
    LayerFilter="cities",
    NameFilter="*",
    TypeFilter=1)
int = Integer(python_2)
item = ListItem(List=pipeline_2, Index=int, Wrap=True)
merge = Merge(Data1=flatten(pipeline), Data2=flatten(item))
pline = PolyLine(Vertices=merge, Closed=True)
previewlw = CustomPreviewLineweights(Geometry=pline, Shader=ColourSwatch(SwatchColor=RGB(255, 0, 0)), Thickness=Slider(2, range=0..10))
len = Length(Curve=pline)

# ---- group: screenshot
python_3 = PythonScript()  # -> path
# ---------- python_3: Python ----------
path = ghenv.Component.OnPingDocument().FilePath
path = path.split("\\")
path = "\\".join(path[:-1] + ["gh.ping"])
# ---------- end python_3 ----------
file_2 = ReadFile(File=python_3, PerLineParse=True)
python_4 = PythonScript(id=file_2)  # -> out
# ---------- python_4: Python ----------
import pickle
import rhinoscriptsyntax as rs

localFolder = "\\".join(ghenv.Component.OnPingDocument().FilePath.split("\\")[:-1]) + "\\"

with open(localFolder + "meta.file", 'rb') as f:
    meta = pickle.load(f)

jobID = meta['jobID']
#    designID = meta['designID']

imageFolder = localFolder + str(jobID) + "\\images\\"
imageName = imageFolder + str(id) + ".png"
rs.Command("_-ViewCaptureToFile \n\"" + imageName + "\"\n _Enter")

outputFile = localFolder + "python.ping"
with open(outputFile, 'w') as f:
    f.write('ack')

print "complete"
# ---------- end python_4 ----------

# ----
merge_2 = Merge(Data1=flatten(len))

# ---- group: write to output file
python_5 = PythonScript(data=merge_2)  # -> out; inputs data: list
# ---------- python_5: Python ----------
import pickle
import rhinoscriptsyntax as rs

localFolder = "\\".join(ghenv.Component.OnPingDocument().FilePath.split("\\")[:-1]) + "\\"

outputFile = localFolder + "outputs.txt"
with open(outputFile, 'w') as f:
    f.write('\n'.join([str(x) for x in data]))

print "complete"
# ---------- end python_5 ----------
